vi "test.gvi"   [LabVIEW NXG 5.1.0]
panel indicators:
  "return": i32
  "data out": u8[]
uses:
  Library.sli::encode_state_size
  Library.sli::encode_init
  NI::Analysis::Generation::Sine Wave.gvi
  NI::Analysis::Generation::Gaussian White Noise.gvi
  Library.sli::encode
diagram:
  call "encode_state_size"() -> (return=w1)
  Initialize Array(element=0, size=w1) -> w2
  call "encode_init"(state in=w2, fs=48000, bitrate=48000) -> (state out=w3)
  call "Sine Wave.gvi"(sample rate=48000, samples=48000, frequency=100) -> (sine wave=w4)
  call "Gaussian White Noise.gvi"(samples=48000) -> (Gaussian white noise=w5)
  Add(w4, w5) -> w6
  Multiply(w6, 0.5) -> w7
  To Single Precision Float(number=w7) -> w8
  Initialize Array(element=0, size=6000) -> w9
  call "encode"(state in=w3, pcm=w8, pcm_size=48000, frame_size=960, data in=w9, max_data_bytes=6000) -> (return=w10, data out=w11)
  $return <- w10
  $"data out" <- w11
